# Dynamo graph 建具表取付場所入力自動化.dyn "251104_建具表取付場所入力自動化" (Dynamo 2.19.3.6394)

categories = Categories("OST_Doors")
current = Document.Current()
activeView = Document.ActiveView(document=current)
all_elements_of_category_in_view = ElementsOfCategoryInView(Category=categories, View=activeView)

# group: 建具を入力してつなぐ部屋を出力する。 重複するものやnullが含まれるものは削除する。
# 結論：使用可能
python_script = Python(IN[0]=all_elements_of_category_in_view)  # CPython3
# ---------- python_script.python (74 lines) ----------
# -*- coding: utf-8 -*-

import clr

# Revit / Dynamo API 参照（ProtoGeometry 等の幾何は未使用）
clr.AddReference("RevitServices")
from RevitServices.Persistence import DocumentManager

clr.AddReference("RevitAPI")
from Autodesk.Revit.DB import BuiltInParameter

# --- 入力 ---
doors = UnwrapElement(IN[0])  # 単体 or リストどちらでも可

# --- 前処理：ActiveView のフェーズを明示取得（精度向上） ---
doc = DocumentManager.Instance.CurrentDBDocument
av = doc.ActiveView
phase_param = av.get_Parameter(BuiltInParameter.VIEW_PHASE)
phase = doc.GetElement(phase_param.AsElementId()) if phase_param else None

# --- 入力を反復可能に正規化 ---
seq = doors if isinstance(doors, (list, tuple)) else [doors]

# --- From/ToRoom 取得（例外非使用・属性存在チェックで分岐） ---
def get_rooms(inst):
    """FamilyInstance から [FromRoom, ToRoom] を返す。取得不可は None。"""
    if inst is None:
        return [None, None]

    # RevitAPI のメソッドがあれば優先（フェーズを明示して精度確保）
    if hasattr(inst, "get_FromRoom") and hasattr(inst, "get_ToRoom") and phase is not None:
        fr = inst.get_FromRoom(phase)
        tr = inst.get_ToRoom(phase)
        return [fr, tr]

    # フォールバック：Dynamo 側の簡易プロパティ
    fr = inst.FromRoom if hasattr(inst, "FromRoom") else None
    tr = inst.ToRoom if hasattr(inst, "ToRoom") else None
    return [fr, tr]

# --- 生ペア生成 ---
raw_pairs = [get_rooms(d) for d in seq]

# --- ユーティリティ：Room -> 安定なID（None対応） ---
def room_id(r):
    return None if r is None else r.Id.IntegerValue

# --- 整理ルール ---
# 1) None を含むペアは除去
# 2) 同じ部屋同士 [x, x] は除去
# 3) [A, B] と [B, A] は同一扱いで重複除去（最初に現れた向きを残す）
unique = []
seen = set()  # key = (min(idA,idB), max(idA,idB))

for fr, tr in raw_pairs:
    ida, idb = room_id(fr), room_id(tr)

    # 1) None を含む → スキップ
    if ida is None or idb is None:
        continue
    # 2) 同一室ペア → スキップ
    if ida == idb:
        continue

    key = (ida, idb) if ida <= idb else (idb, ida)  # 順序無視キー
    if key in seen:
        continue
    seen.add(key)
    unique.append([fr, tr])  # 向き（From/To）は最初の出現を維持

# --- 出力（形状互換） ---
# ・リスト入力 → [[from, to], ...]（整理済み）
# ・単体入力   → [from, to] or []（条件を満たさない場合は空）
OUT = unique if isinstance(doors, (list, tuple)) else (unique[0] if unique else [])
# ----------------------------------------
name = Room.Name(room=python_script)

categories_2 = Categories("OST_Rooms")
all_elements_of_category_in_view_2 = ElementsOfCategoryInView(Category=categories_2, View=activeView)
近接中心性のパラメーター名 = CodeBlock { "近接中心性"; }
次数中心性のパラメーター名 = CodeBlock { "次数中心性"; }

# group: 部屋に入力されている近接中心性と次数中心性を空にする
# 説明<グループの説明を編集するにはここをダブル クリック>
code_block = CodeBlock { 9999999; }
setParameterByName = Element.SetParameterByName(element=all_elements_of_category_in_view_2, parameterName=近接中心性のパラメーター名, value=code_block)
setParameterByName_2 = Element.SetParameterByName(element=all_elements_of_category_in_view_2, parameterName=次数中心性のパラメーター名, value=code_block)

# group: 部屋に入力されている近接中心性と次数中心性を空になったら次に進む
# 説明<グループの説明を編集するにはここをダブル クリック>
code_block_2 = CodeBlock(x=setParameterByName, y=setParameterByName_2) { List.Count(x)==List.Count(y); }
code_block_3 = CodeBlock { null; }
if_ = RefactoredIf(test=code_block_2, true=all_elements_of_category_in_view_2, false=code_block_3)

# group: 部屋から部屋境界線で隣り合う部屋の組み合わせを抽出する
# 結論：使用可能
python_script_2 = Python(IN[0]=if_)  # CPython3
# ---------- python_script_2.python (267 lines) ----------
# Dynamo Python (CPython3) – Adjacent Room Pairs from Rooms
# RSL-only sampling + Wall-overlap exclusion (Revit 2024)

import clr, math
clr.AddReference('RevitAPI')
clr.AddReference('RevitServices')

from Autodesk.Revit.DB import *
from RevitServices.Persistence import DocumentManager

doc = DocumentManager.Instance.CurrentDBDocument
ZAXIS = XYZ.BasisZ

# ---------- 単位 ----------
def mm_to_internal(mm):
    return UnitUtils.ConvertToInternalUnits(mm, UnitTypeId.Millimeters)

# ---------- パラメータ（既定値） ----------
offset_mm      = 350.0
sample_step_mm = 500.0
overlap_pad_mm = 30.0   # 壁重なり許容（±mm）
parallel_tol_deg = 10.0 # 平行判定

if 'IN' in globals():
    if len(IN) >= 2 and IN[1] is not None:
        try: offset_mm = float(IN[1])
        except: pass
    if len(IN) >= 3 and IN[2] is not None:
        try: sample_step_mm = float(IN[2])
        except: pass

OFFSET      = mm_to_internal(offset_mm)
STEP        = mm_to_internal(sample_step_mm)
BB_PAD      = mm_to_internal(400.0)
OVERLAP_PAD = mm_to_internal(overlap_pad_mm)
COS_TOL     = math.cos(math.radians(parallel_tol_deg))

# ---------- ユーティリティ ----------
def to_db(elem):
    api = getattr(elem, 'InternalElement', None)
    if api: return api
    try:
        return UnwrapElement(elem)
    except:
        return elem

def is_room(e):
    try:
        return isinstance(e, SpatialElement) and e.Category and \
               e.Category.Id.IntegerValue == int(BuiltInCategory.OST_Rooms)
    except:
        return False

def norm_vec(v):
    if not v or v.GetLength() < 1e-12:
        return XYZ.BasisX
    return v.Normalize()

def tangent_xy(curve, param, normalized=False):
    try:
        deriv = curve.ComputeDerivatives(param, normalized)
        tvec  = norm_vec(deriv.BasisX)
    except:
        p0, p1 = curve.GetEndPoint(0), curve.GetEndPoint(1)
        tvec = norm_vec(p1.Subtract(p0))
    return tvec

def normal_xy_from_tangent(tvec):
    n = ZAXIS.CrossProduct(tvec)
    return norm_vec(n) if n.GetLength() >= 1e-12 else XYZ.BasisX

def expand_bbox_xy(bb, pad):
    if bb is None: return None
    mn, mx = bb.Min, bb.Max
    mn2 = XYZ(mn.X - pad, mn.Y - pad, mn.Z)
    mx2 = XYZ(mx.X + pad, mx.Y + pad, mx.Z)
    bb2 = BoundingBoxXYZ(); bb2.Min = mn2; bb2.Max = mx2
    return bb2

def bbox2d_contains(bb, pt):
    if bb is None: return True
    mn, mx = bb.Min, bb.Max
    x, y = pt.X, pt.Y
    return (mn.X <= x <= mx.X) and (mn.Y <= y <= mx.Y)

def candidate_rooms(pt, room_bbs):
    return [r for (r, bb) in room_bbs if bbox2d_contains(bb, pt)]

def room_at_point_prefiltered(pt, room_bbs):
    for r in candidate_rooms(pt, room_bbs):
        try:
            if r.IsPointInRoom(pt):
                return r
        except: pass
    return None

# 弧長 STEP ピッチでサンプリング
def length_uniform_samples(curve, step_len):
    pts = []
    poly = curve.Tessellate()
    if not poly or len(poly) < 2:
        try: pts.append(curve.Evaluate(0.5, True))
        except: pass
        return pts

    cum = [0.0]
    for i in range(1, len(poly)):
        seg_len = poly[i].DistanceTo(poly[i-1])
        cum.append(cum[-1] + seg_len)
    total = cum[-1]
    if total < 1e-8:
        try: pts.append(curve.Evaluate(0.5, True))
        except: pass
        return pts

    n = max(1, int(total / step_len))
    targets = [total * (k / float(n + 1)) for k in range(1, n + 1)]

    j = 1
    for d in targets:
        while j < len(cum) and cum[j] < d:
            j += 1
        if j >= len(cum): break
        d0, d1 = cum[j-1], cum[j]
        t = 0.5 if (d1 - d0) < 1e-12 else (d - d0) / (d1 - d0)
        vec = poly[j].Subtract(poly[j-1])
        p = poly[j-1].Add(vec.Multiply(t))
        pts.append(p)

    if not pts:
        try: pts.append(curve.Evaluate(0.5, True))
        except: pass
    return pts

# ---------- 壁データ ----------
def wall_half_thickness(wall):
    try:
        wt = wall.WallType
        if wt: return 0.5 * float(wt.Width)
    except: pass
    try:
        p = wall.WallType.get_Parameter(BuiltInParameter.WALL_ATTR_WIDTH_PARAM)
        if p: return 0.5 * float(p.AsDouble())
    except: pass
    return mm_to_internal(50.0)

walls = list(FilteredElementCollector(doc).OfClass(Wall).WhereElementIsNotElementType())
walls_data = []
for w in walls:
    try:
        loc = w.Location
        if isinstance(loc, LocationCurve):
            c = loc.Curve
            if c and c.Length > 1e-6:
                walls_data.append((w, c, wall_half_thickness(w)))
    except: pass

def is_overlapped_with_wall(pm, rsl_tangent, walls_data):
    for w, wc, half_t in walls_data:
        prj = wc.Project(pm)
        if not prj: 
            continue
        q = prj.XYZPoint
        dx = pm.X - q.X; dy = pm.Y - q.Y
        dist_xy = (dx*dx + dy*dy) ** 0.5
        if dist_xy > (half_t + OVERLAP_PAD):
            continue
        w_tan = tangent_xy(wc, prj.Parameter, normalized=False)
        if abs(rsl_tangent.DotProduct(w_tan)) >= COS_TOL:
            return True
    return False

# ---------- 入力の Rooms ----------
rooms_input = None
if 'IN' in globals() and len(IN) >= 1 and IN[0] is not None:
    elems_in = IN[0] if isinstance(IN[0], list) else [IN[0]]
    rooms_input = [to_db(e) for e in elems_in if e is not None]

if rooms_input and all(is_room(r) for r in rooms_input):
    rooms = rooms_input
else:
    rooms = list(
        FilteredElementCollector(doc)
        .OfCategory(BuiltInCategory.OST_Rooms)
        .WhereElementIsNotElementType()
    )

# ---------- 近傍探索用に Room の膨張BBox ----------
room_bbs = []
for r in rooms:
    try:
        bb = r.get_BoundingBox(None)
        bb = expand_bbox_xy(bb, BB_PAD) if bb else None
    except:
        bb = None
    room_bbs.append((r, bb))

# ---------- メイン（RSLのみを対象） ----------
opt = SpatialElementBoundaryOptions()
opt.SpatialElementBoundaryLocation = SpatialElementBoundaryLocation.Finish

pair_flags = {}  # key -> {"clean":bool, "dirty":bool}

def mark_pair(a, b, clean_sample):
    ida = a.Id.IntegerValue; idb = b.Id.IntegerValue
    key = (ida, idb) if ida < idb else (idb, ida)
    flags = pair_flags.get(key, {"clean": False, "dirty": False})
    if clean_sample: flags["clean"] = True
    else:            flags["dirty"] = True
    pair_flags[key] = flags

for rm in rooms:
    segloops = rm.GetBoundarySegments(opt)
    if not segloops: 
        continue

    for loop in segloops:
        for seg in loop:
            # ★ ここで RSL（部屋分割線）以外の境界は完全に除外 ★
            eid = seg.ElementId
            if not eid or eid == ElementId.InvalidElementId:
                continue
            host = doc.GetElement(eid)
            if not isinstance(host, CurveElement):
                continue
            cat = host.Category
            if not cat or cat.Id.IntegerValue != int(BuiltInCategory.OST_RoomSeparationLines):
                continue

            # RSL の実曲線で判定
            c = seg.GetCurve() if hasattr(seg, "GetCurve") else getattr(seg, "Curve", None)
            if c is None or c.Length < 1e-8:
                continue

            for pm in length_uniform_samples(c, STEP):
                prj = c.Project(pm)
                tparam = prj.Parameter if prj else 0.5
                tvec = tangent_xy(c, tparam, normalized=False)
                nvec = normal_xy_from_tangent(tvec)

                pL = pm.Add(nvec.Multiply(OFFSET))
                pR = pm.Add(nvec.Negate().Multiply(OFFSET))

                left  = room_at_point_prefiltered(pL, room_bbs)
                right = room_at_point_prefiltered(pR, room_bbs)

                # rm と向かい合う相手が見つかった場合のみ、壁重なりを評価
                if left is rm and right is not None and right.Id != rm.Id:
                    overlapped = is_overlapped_with_wall(pm, tvec, walls_data)
                    mark_pair(rm, right, clean_sample=(not overlapped))
                elif right is rm and left is not None and left.Id != rm.Id:
                    overlapped = is_overlapped_with_wall(pm, tvec, walls_data)
                    mark_pair(rm, left, clean_sample=(not overlapped))

# ---------- 出力 ----------
pairs = []
for (ida, idb), flags in pair_flags.items():
    if flags.get("clean", False):  # RSL単独で接している点が1箇所でもある
        a = doc.GetElement(ElementId(ida))
        b = doc.GetElement(ElementId(idb))
        if a and b:
            pairs.append([a, b])

if not pairs:
    pairs = [[None, None]]

OUT = pairs
# ----------------------------------------
name_2 = Room.Name(room=python_script_2)

python_script_3 = Python(IN[0]=python_script_2, IN[1]=python_script)  # CPython3
# ---------- python_script_3.python (79 lines) ----------
# -*- coding: utf-8 -*-

# IN[0], IN[1] は、次のどちらかが入る前提：
#  1) [[RoomX, RoomY], ...] という「ペアのリスト」
#  2) [RoomX, RoomY, ...] という「部屋のリスト」
A = IN[0] or []
B = IN[1] or []

# ---- 入力が「ペアのリスト」かどうかを判定 ----
def is_pair_list(x):
    return (
        isinstance(x, (list, tuple)) and
        len(x) > 0 and
        isinstance(x[0], (list, tuple)) and
        len(x[0]) >= 2
    )

# ---- Room を安定して比較できるキーへ ----
def room_key(room):
    if room is None:
        return None
    rid = getattr(room, "Id", None)
    if rid is not None:
        iv = getattr(rid, "IntegerValue", None)
        if isinstance(iv, int):
            return iv
    uid = getattr(room, "UniqueId", None)
    if uid is not None:
        return str(uid)
    # 最後の保険：文字列化
    return str(room)

# ---- 入力を「ペアの配列」に正規化 ----
pairs = []

# A/B がペアのリストならそのまま追加
if is_pair_list(A):
    pairs.extend(A)
if is_pair_list(B):
    pairs.extend(B)

# A/B が部屋のリストなら、対応する要素でペア化（短い方に合わせる）
roomsA = A if (not is_pair_list(A) and isinstance(A, (list, tuple))) else []
roomsB = B if (not is_pair_list(B) and isinstance(B, (list, tuple))) else []
if roomsA and roomsB:
    n = min(len(roomsA), len(roomsB))
    for i in range(n):
        pairs.append([roomsA[i], roomsB[i]])

# ---- 整理：None除外 / 同室除外 / 順序無視の重複除外 ----
unique = []
seen = set()  # key = tuple(sorted([keyA_str, keyB_str]))

for p in pairs:
    if not isinstance(p, (list, tuple)) or len(p) < 2:
        continue

    fr, to = p[0], p[1]
    if fr is None or to is None:
        continue

    kf, kt = room_key(fr), room_key(to)
    if kf is None or kt is None:
        continue

    # 同じ部屋同士 [x, x] は除外
    if str(kf) == str(kt):
        continue

    # 並べ替えるのはキー（文字列）だけ → .NET オブジェクトをソートしない
    key_sorted = tuple(sorted((str(kf), str(kt))))
    if key_sorted in seen:
        continue

    seen.add(key_sorted)
    # 向き（From→To）は最初に現れたものを採用
    unique.append([fr, to])

OUT = unique
# ----------------------------------------

# group: 部屋の組合せから近接中心性を求める
# 説明<グループの説明を編集するにはここをダブル クリック>
python_script_4 = Python(IN[0]=python_script_3)  # CPython3
# ---------- python_script_4.python (112 lines) ----------
# -*- coding: utf-8 -*-

from collections import deque, defaultdict
from typing import List, Tuple, Dict, Hashable

# ---------- 入力 ----------
# IN[0] : [[RoomA, RoomB], [RoomC, RoomD], ...] という部屋ペアのリスト
pairs = IN[0] or []

# ---------- Room -> 比較用キー（ハッシュ可能） ----------
def room_key(room):
    if room is None:
        return None
    rid = getattr(room, "Id", None)
    if rid is not None:
        iv = getattr(rid, "IntegerValue", None)
        if isinstance(iv, int):
            return iv
    uid = getattr(room, "UniqueId", None)
    if uid is not None:
        return str(uid)
    # 最後の保険
    return str(room)

# ---------- ペアから無向エッジ集合を作成（自己ループ除去・重複除去） ----------
# ここでは (u, v) という「キーのタプル」へ変換します
edge_set = set()
key_to_room = {}  # 表示用：計算キー -> 代表Room（最初に出てきたもの）

for p in pairs:
    if not isinstance(p, (list, tuple)) or len(p) < 2:
        continue
    a, b = p[0], p[1]
    if a is None or b is None:
        continue

    ka, kb = room_key(a), room_key(b)
    if ka is None or kb is None:
        continue
    if ka == kb:          # 自己ループ除外
        continue

    # 代表オブジェクト（最初に見つけた方）を記録
    if ka not in key_to_room:
        key_to_room[ka] = a
    if kb not in key_to_room:
        key_to_room[kb] = b

    # 無向エッジは並び順に依らず1本に正規化
    e = (ka, kb) if ka <= kb else (kb, ka)
    edge_set.add(e)

edges = list(edge_set)  # List[Tuple[Hashable, Hashable]]

# ---------- 近接中心性（NetworkX と同じ定義 / 無向・非重み） ----------
def closeness_centrality(
    edges: List[Tuple[Hashable, Hashable]],
    wf_improved: bool = True,
) -> Dict[Hashable, float]:
    # 隣接集合
    adj: Dict[Hashable, set] = defaultdict(set)
    for u, v in edges:
        if u == v:
            continue
        adj[u].add(v)
        adj[v].add(u)

    nodes = list(adj.keys())
    N = len(nodes)
    if N == 0:
        return {}

    def bfs_sum_dist(start):
        dist = {start: 0}
        q = deque([start])
        while q:
            x = q.popleft()
            for y in adj[x]:
                if y not in dist:
                    dist[y] = dist[x] + 1
                    q.append(y)
        total = sum(d for n, d in dist.items() if n != start)
        reachable = len(dist)
        return total, reachable

    C = {}
    for s in nodes:
        total_dist, reachable = bfs_sum_dist(s)
        if reachable <= 1 or total_dist == 0:
            C[s] = 0.0
            continue
        score = (reachable - 1) / total_dist
        if wf_improved and N > 1:
            score *= (reachable - 1) / (N - 1)
        C[s] = float(score)
    return C

# ---------- 計算 ----------
scores = closeness_centrality(edges, wf_improved=True)

# ---------- Room オブジェクトへ戻して見やすく整形 ----------
# [[Room, score], ...] をスコア降順で
result_list = []
for k, s in scores.items():
    room = key_to_room.get(k, None)
    result_list.append([room, s])

result_list.sort(key=lambda z: z[1], reverse=True)

# 参考として、エッジ（キー表現）やキー→Roomの対応を返すことも可能
# OUT = [result_list, edges, key_to_room]
OUT = result_list
# ----------------------------------------

# group: 部屋に近接中心性の値を入力
# 説明<グループの説明を編集するにはここをダブル クリック>
code_block_4 = CodeBlock { 0; }
getItemAtIndex = List.GetItemAtIndex(list=python_script_4@L2, index=code_block_4)
code_block_5 = CodeBlock { 1; }
getItemAtIndex_2 = List.GetItemAtIndex(list=python_script_4@L2, index=code_block_5)
setParameterByName_3 = Element.SetParameterByName(element=getItemAtIndex, parameterName=近接中心性のパラメーター名, value=getItemAtIndex_2)

code_block_6 = CodeBlock(x=setParameterByName_3) { List.Count(x)>0; }
code_block_7 = CodeBlock { null; }
if_2 = RefactoredIf(test=code_block_6, true=all_elements_of_category_in_view, false=code_block_7)

# group: 入力された建具の部屋計算ポイントの部屋の 近接中心性、もしくは次数中心性を比べて 取付場所_変数に変数を入力する。
# 部屋から　>　部屋へ　→　2
# 部屋から　<　部屋へ　→　1
# 空の場合　→　0
python_script_5 = Python(IN[0]=if_2, IN[1]=近接中心性のパラメーター名, IN[2]=次数中心性のパラメーター名)  # CPython3
# ---------- python_script_5.python (237 lines) ----------
# -*- coding: utf-8 -*-

import clr

# Dynamo / Revit API
clr.AddReference("RevitServices")
from RevitServices.Persistence import DocumentManager
from RevitServices.Transactions import TransactionManager

clr.AddReference("RevitNodes")
import Revit
clr.ImportExtensions(Revit.Elements)

clr.AddReference("RevitAPI")
from Autodesk.Revit.DB import BuiltInParameter, StorageType

# ===== 入力 =====
doors_in = UnwrapElement(IN[0])                           # ドア（単体 or リスト）
PARAM_NAME_SCORE  = IN[1] if IN[1] else u"近接中心性"     # ⑫ 可変：近接中心性
PARAM_NAME_DEGREE = IN[2] if IN[2] else u"次数中心性"     # ⑬ 可変：次数中心性
PARAM_NAME_OUTPUT = u"取付場所_変数"

doors = doors_in if isinstance(doors_in, (list, tuple)) else [doors_in]

# ===== 前処理：ActiveView のフェーズ（From/ToRoom取得の精度向上） =====
doc = DocumentManager.Instance.CurrentDBDocument
av = doc.ActiveView
phase_param = av.get_Parameter(BuiltInParameter.VIEW_PHASE)
phase = doc.GetElement(phase_param.AsElementId()) if phase_param else None

def get_rooms(inst):
    """ドア(FamilyInstance)から [FromRoom, ToRoom] を返す。取得不可は None。"""
    if inst is None:
        return [None, None]
    if hasattr(inst, "get_FromRoom") and hasattr(inst, "get_ToRoom") and phase is not None:
        return [inst.get_FromRoom(phase), inst.get_ToRoom(phase)]
    # フォールバック（Dynamo簡易プロパティ）
    fr = getattr(inst, "FromRoom", None)
    tr = getattr(inst, "ToRoom", None)
    return [fr, tr]

def parse_numeric_from_param(p):
    """
    Parameter から数値(float)を取得。
    未設定/取得不可は None を返す。
    """
    if p is None:
        return None
    try:
        st = p.StorageType
        if st == StorageType.Double:
            v = p.AsDouble()
            return None if v is None else float(v)
        elif st == StorageType.Integer:
            v = p.AsInteger()
            return None if v is None else float(v)
        elif st == StorageType.String:
            s = p.AsString()
            if s is None:
                return None
            s = s.strip()
            if s == "":
                return None
            s = s.replace(",", "").replace("，", "").replace("．", ".")
            try:
                return float(s)
            except:
                return None
        else:
            return None
    except:
        return None

def get_room_value(room, param_name):
    """Room 要素から param_name を Lookup し数値化して返す（なければ None）。"""
    if room is None:
        return None
    try:
        p = room.LookupParameter(param_name)
        return parse_numeric_from_param(p)
    except:
        return None

def clear_output_param(elem, param_name):
    """
    ② 既存の「取付場所_変数」を削除（クリア）。
      - String型: 空文字
      - Integer/Double型: 0
    """
    if elem is None:
        return False
    p = elem.LookupParameter(param_name)
    if p is None or p.IsReadOnly:
        return False
    try:
        if p.StorageType == StorageType.String:
            return p.Set("")
        elif p.StorageType == StorageType.Integer:
            return p.Set(0)
        elif p.StorageType == StorageType.Double:
            return p.Set(0.0)
        else:
            return False
    except:
        return False

def set_output_param(elem, param_name, value):
    """
    ⑩ 判定値を書き込み。
    value が None（null）なら書き込まず、②でクリアした状態のままにする。
    """
    if elem is None or value is None:
        return False
    p = elem.LookupParameter(param_name)
    if p is None or p.IsReadOnly:
        return False
    try:
        if p.StorageType == StorageType.Integer:
            return p.Set(int(value))
        elif p.StorageType == StorageType.Double:
            return p.Set(float(value))
        elif p.StorageType == StorageType.String:
            return p.Set(str(int(value)))
        else:
            return False
    except:
        return False

def same_room(fr, to):
    """
    FromRoom / ToRoom が同一か判定（⑧）。
    ElementId で比較。どちらか None の場合は False。
    """
    if fr is None or to is None:
        return False
    try:
        return fr.Id == to.Id
    except:
        return False

def decide_value(fr, to, fr_score, to_score, fr_degree, to_degree):
    """
    ③〜⑨の判定ロジックを実装して値を返す。
      1: To側優先
      2: From側優先
      3: 同値（同点）
      0: 両方 None（⑨）
      None: null（⑥）
    優先順位（安全側で早期判定）:
      A) ⑨ 両方の部屋が None → 0
      B) ⑧ 同一室 → 1
      C) ⑥ 近接中心性が両方 None → None
      D) ④ Fromのみ近接中心性あり → 1
      E) ⑤ Toのみ近接中心性あり   → 2
      F) ③ 近接中心性を比較（From>To→2, To>From→1, 同点→Gへ）
      G) ⑥（同点時）次数中心性で比較（From>To→2, To>From→1, 同点/欠損→Hへ）
      H) ⑦ フォールバック：部屋の存在で決定（Fromのみ→1, Toのみ→2, 両方→1）
    """
    # A) ⑨ 両方 None
    if fr is None and to is None:
        return 0

    # B) ⑧ 同一室
    if same_room(fr, to):
        return 1

    # C) ⑥ 近接中心性が両方 None（null）
    if fr_score is None and to_score is None:
        return None

    # D) ④ Fromのみ入力
    if fr_score is not None and to_score is None:
        return 1

    # E) ⑤ Toのみ入力
    if fr_score is None and to_score is not None:
        return 2

    # F) ③ 両方あり：近接中心性で大小比較
    if fr_score is not None and to_score is not None:
        if fr_score > to_score:
            return 2
        elif fr_score < to_score:
            return 1
        # 同点 → 次数中心性比較へ

    # G) ⑥（同点時）次数中心性で比較
    if fr_degree is not None and to_degree is not None:
        if fr_degree > to_degree:
            return 2
        elif fr_degree < to_degree:
            return 1
        else:
            # 完全同点 → フォールバックへ
            pass
    elif fr_degree is not None and to_degree is None:
        # Fromのみ次数中心性があるが、仕様上ここで確定指示は無いのでフォールバックへ
        pass
    elif fr_degree is None and to_degree is not None:
        # Toのみ次数中心性があるが、仕様上ここで確定指示は無いのでフォールバックへ
        pass

    # H) ⑦ フォールバック：From/To の「存在」で判定
    if fr is not None and to is None:
        return 1
    if fr is None and to is not None:
        return 2
    # 両方存在する場合は 1 を返す（タイブレーク）
    return 1

results = []

TransactionManager.Instance.EnsureInTransaction(doc)
for d in doors:
    # ② 既存「取付場所_変数」を削除（クリア）
    clear_output_param(d, PARAM_NAME_OUTPUT)

    # From / To 取得
    fr, to = get_rooms(d)

    # 近接中心性・次数中心性の値取得
    fr_score  = get_room_value(fr, PARAM_NAME_SCORE)
    to_score  = get_room_value(to, PARAM_NAME_SCORE)
    fr_degree = get_room_value(fr, PARAM_NAME_DEGREE)
    to_degree = get_room_value(to, PARAM_NAME_DEGREE)

    # ③〜⑨ 判定
    decided = decide_value(fr, to, fr_score, to_score, fr_degree, to_degree)

    # ⑩ パラメーターへ書き込み（None は書き込まずクリア状態を維持）
    set_output_param(d, PARAM_NAME_OUTPUT, decided)

    results.append(decided)
TransactionManager.Instance.TransactionTaskDone()

# 出力：単体入力は単体、リスト入力はリスト
OUT = results if isinstance(doors_in, (list, tuple)) else (results[0] if results else None)
# ----------------------------------------

# group: 部屋の組合せから次数中心性を求める
# 説明<グループの説明を編集するにはここをダブル クリック>
python_script_6 = Python(IN[0]=python_script_3)  # CPython3
# ---------- python_script_6.python (88 lines) ----------
# -*- coding: utf-8 -*-

from collections import defaultdict
from typing import List, Tuple, Dict, Hashable

# ---------- 入力 ----------
# IN[0] : [[RoomA, RoomB], [RoomC, RoomD], ...] という部屋ペアのリスト
pairs = IN[0] or []

# ---------- Room -> 比較用キー（ハッシュ可能） ----------
def room_key(room):
    if room is None:
        return None
    rid = getattr(room, "Id", None)
    if rid is not None:
        iv = getattr(rid, "IntegerValue", None)
        if isinstance(iv, int):
            return iv
    uid = getattr(room, "UniqueId", None)
    if uid is not None:
        return str(uid)
    # 最後の保険
    return str(room)

# ---------- ペアから無向エッジ集合を作成（自己ループ除去・重複除去） ----------
edge_set = set()
key_to_room = {}

for p in pairs:
    if not isinstance(p, (list, tuple)) or len(p) < 2:
        continue
    a, b = p[0], p[1]
    if a is None or b is None:
        continue

    ka, kb = room_key(a), room_key(b)
    if ka is None or kb is None:
        continue
    if ka == kb:
        continue  # 自己ループ除外

    if ka not in key_to_room:
        key_to_room[ka] = a
    if kb not in key_to_room:
        key_to_room[kb] = b

    e = (ka, kb) if ka <= kb else (kb, ka)
    edge_set.add(e)

edges: List[Tuple[Hashable, Hashable]] = list(edge_set)

# ---------- 次数中心性（NetworkX と同定義） ----------
def degree_centrality_with_degree(
    edges: List[Tuple[Hashable, Hashable]],
) -> Dict[Hashable, Tuple[float, int]]:
    """
    無向・非重み付きグラフの次数中心性と次数を同時に返す。
      centrality(v) = degree(v) / (n - 1)
      degree(v) = 隣接ノード数
    """
    adj: Dict[Hashable, set] = defaultdict(set)
    for u, v in edges:
        if u == v:
            continue
        adj[u].add(v)
        adj[v].add(u)

    nodes = list(adj.keys())
    n = len(nodes)
    if n <= 1:
        return {v: (0.0, 0) for v in nodes}

    denom = float(n - 1)
    return {v: (len(adj[v]) / denom, len(adj[v])) for v in nodes}

# ---------- 計算 ----------
scores = degree_centrality_with_degree(edges)

# ---------- Room オブジェクトへ戻して整形（スコア降順） ----------
result_list = []
for k, (norm_score, degree) in scores.items():
    room = key_to_room.get(k, None)
    result_list.append([room, norm_score, degree])

result_list.sort(key=lambda z: z[1], reverse=True)

# ---------- 出力 ----------
OUT = result_list
# ----------------------------------------

# group: 部屋に近接中心性の値を入力
# 説明<グループの説明を編集するにはここをダブル クリック>
code_block_8 = CodeBlock { 0; }
getItemAtIndex_3 = List.GetItemAtIndex(list=python_script_6@L2, index=code_block_8)
code_block_9 = CodeBlock { 2; }
getItemAtIndex_4 = List.GetItemAtIndex(list=python_script_6@L2, index=code_block_9)
setParameterByName_4 = Element.SetParameterByName(element=getItemAtIndex_3, parameterName=次数中心性のパラメーター名, value=getItemAtIndex_4)
